# Grasshopper definition RockingPenHolder_Sep19.gh (Grasshopper 1.0.8)
# plug-ins: Weaverbird, IntraLattice, Kangaroo2 Components

# Set the origin
pt = ConstructPoint(XCoordinate=0, YCoordinate=0, ZCoordinate=0)
origin = Point(pt)

height_to_radius_ratio = Slider(0.637, range=0..1)
radius_of_bottom_part = Slider(58, range=0..300)
multiplication = Multiplication(A=radius_of_bottom_part, B=height_to_radius_ratio)
# Create the sphere, adjust height to set the sphere on the origin plane
Z = UnitZ(Factor=multiplication)
move = Move(Geometry=origin, Motion=Z)  # -> Geometry, Transform
pln = Plane(move.Geometry)
sph = Sphere(Base=pln, Radius=radius_of_bottom_part)
scale_nu = ScaleNU(Geometry=sph, Plane=pln, ScaleX=1, ScaleY=1, ScaleZ=height_to_radius_ratio)  # -> Geometry, Transform

# ----
# Create box to cut the sphere
num = Number(radius_of_bottom_part)
division = Division(A=num, B="0.2")
neg = Negative(Value=division)
dom = ConstructDomain(DomainStart=division, DomainEnd=neg)
domain = Domain(dom)
rectangle = Rectangle(Plane=pln, XSize=domain, YSize=domain, Radius=0)  # -> Rectangle, Length
multiplication_2 = Multiplication(A=multiplication, B=Slider(2, range=0..10))
boxrec = BoxRectangle(Rectangle=rectangle.Rectangle, Height=multiplication_2)

top_to_bottom_ratio = Slider(0.768, range=0..0.9)
wall_thickness = Slider(1, range=1..10)
height = Slider(66, range=0..300)
neg_2 = Negative(Value=wall_thickness)
cir = Circle(Plane=pln, Radius=radius_of_bottom_part)

# ----
# Outter Loft Brep
panel = Panel(radius_of_bottom_part)
# Calculating the Opening size relative to the bottom part radius
panel_2 = Panel("0")
dom_2 = ConstructDomain(DomainStart=panel_2, DomainEnd="1")
dom_3 = ConstructDomain(DomainStart=wall_thickness, DomainEnd=panel)
remap = RemapNumbers(Value=top_to_bottom_ratio, Source=dom_2, Target=dom_3)  # -> Mapped, Clipped
panel_3 = Panel(remap.Mapped)

Z_2 = UnitZ(Factor=height)
move_2 = Move(Geometry=pln, Motion=Z_2)  # -> Geometry, Transform
cir_2 = Circle(Plane=move_2.Geometry, Radius=radius_of_bottom_part)
pln_2 = Plane(move_2.Geometry)
neg_3 = Negative(Value=remap.Mapped)
offset = OffsetCurve(Curve=cir_2, Distance=neg_3, Plane=pln_2, Corners=1)
neg_4 = Negative(Value=wall_thickness)
offset_2 = OffsetCurve(Curve=offset, Distance=neg_4, Corners=1)
outter_cricle = Merge(Data1=offset, Data2=cir)
loft_outter = Loft(
    Curves=flatten(outter_cricle),
    Options={Adjust=False, Closed=False, LoftEnds=0, LoftSimp=0, LoftType=0, Rebuild=10, Refit=0.01})
cap = CapHoles(Brep=loft_outter)

mesh = MeshBrep(
    Brep=cap,
    Settings={GridMaxCount=0, GridMinCount=16, JaggedSeams=False, MaxEdgeLength=0, MinEdgeLength=0.0001, MinTolerance=0, Refine=True, RefineAngle=0, RelativeTolerance=0.65, SimplePlanes=True, Tolerance=0})

# ---- group: INPUT MESH
# VORONOI
mesh_2 = Mesh(mesh)
weld = WeldMesh(Mesh=mesh_2, Angle=3.141592654)

# ---- group: CREATE INITIAL VORONOI
pop3d = Populate3D(Region=weld, Count=Slider(1886, range=0..10000), Seed=1)
minc = MeshInclusion(Mesh=weld, Point=pop3d, Strict=True)
cull = CullPattern(List=pop3d, CullPattern=minc)
voronoi³ = Voronoi3D(Points=cull)  # -> Cells, Boundary

# ---- group: CREATE OUTER VORONOI SKIN
mmx = MeshMesh(MeshA=voronoi³.Cells, MeshB=weld)
explode = Explode(Curve=mmx, Recursive=True)  # -> flatten(Segments), Vertices
dupln = RemoveDuplicateLines(Lines=explode.Segments, Tolerance=0.01)

# ----
merge = Merge(Data1=dupln)  # -> flatten(Result)

# ----
# Inner Loft Brep
offset_3 = OffsetCurve(Curve=cir, Distance=neg_2, Plane=pln, Corners=1)
inner_circle = Merge(Data1=offset_2, Data2=offset_3)
loft_inner = Loft(
    Curves=flatten(inner_circle),
    Options={Adjust=False, Closed=False, LoftEnds=0, LoftSimp=0, LoftType=0, Rebuild=10, Refit=0.01})
cap_2 = CapHoles(Brep=loft_inner)

# ---- group: REPLACE POINTS WITHIN THRESHOLD WITH AVERAGE POINT
disc = Discontinuity(Curve=merge, Level=1)  # -> simplify(Points), Parameters
cullpt = CullDuplicates(Points=flatten(disc.Points), Tolerance=Slider(0.6, range=0.1..1), CullMode=3)  # -> simplify(Points), Indices, Valence
cp = ClosestPoint(Point=disc.Points, Cloud=cullpt.Points)  # -> simplify(ClosestPoint), CPIndex, Distance

# ----
circle = Circle(offset_2)

radius_of_pen = Slider(1.66, range=0..5)
# Representation of Pen (maximum)
pen_additional_height = Slider(4, range=-10..20)
Z_3 = UnitZ(Factor=height)
neg_5 = Negative(Value=Z_3)
cir_3 = Circle(Plane=circle, Radius=radius_of_pen)
move_3 = Move(Geometry=offset_2, Motion=neg_5)  # -> Geometry, Transform
darc = DeconstructArc(Arc=circle)  # -> BasePlane, Radius, Angle
area = Area(Geometry=circle)  # -> Area, Centroid
area_2 = Area(Geometry=cir_3)  # -> Area, Centroid
addition = Addition(A=height, B=pen_additional_height)
cyl = Cylinder(Base=move_3.Geometry, Radius=darc.Radius, Length=addition)
division_2 = Division(A=area.Area, B=area_2.Area)
int = Integer(division_2)
cap_3 = CapHoles(Brep=cyl)
panel_4 = Panel(int)
tag = TextTag3D(
    Location=circle,
    Text=panel_4,
    Size=Slider(3, range=0..100),
    Colour=ColourSwatch(SwatchColor=RGB(0, 133, 35)),
    Justification=7)

panel_5 = Panel(addition)

# ----
# Lofted Brep Shell
sdiff = SolidDifference(BrepsA=cap, BrepsB=cap_2)
sdiff_2 = SolidDifference(BrepsA=scale_nu.Geometry, BrepsB=boxrec)
top = Brep(sdiff)
bottom = Brep(sdiff_2)
merge_2 = Merge(Data1=top, Data2=bottom)
sunion = SolidUnion(Breps=merge_2)
brep = Brep(sunion)

# ---- group: REMOVE ZERO DISTANCE LINES
item = ListItem(List=cp.ClosestPoint, Index=0, Wrap=True)  # -> Item, Item1
dist = Distance(PointA=item.Item, PointB=item.Item1)
cull_2 = CullPattern(List=cp.ClosestPoint, CullPattern=dist)
clean = CleanTree(RemoveNulls=True, RemoveInvalid=True, RemoveEmpty=True, Tree=cull_2)

# ----
# Center of gravity of Pen
brep_2 = Brep(cap_3)

# ----
# Center of gravity of bottom part
number_slider = Slider(100, range=0..100)
# Center of gravity of Pen holder
swatch = ColourSwatch(SwatchColor=RGB(140, 215, 255))
material = CreateMaterial(
    Diffuse=swatch,
    Specular=RGB(255, 255, 255),
    Emission=RGB(0, 0, 0),
    Transparency=Slider(1, range=0..1),
    Shine=number_slider)
volume = Volume(Geometry=brep)  # -> Volume, Centroid
preview = CustomPreview(Geometry=brep, Material=material)
panel_6 = Panel(volume.Centroid)
pt_2 = Point(volume.Centroid)
sph_2 = Sphere(Base=pt_2, Radius=Slider(10, range=0..100))
preview_2 = CustomPreview(Geometry=pt_2, Material=ColourSwatch(SwatchColor=RGB(255, 153, 0)))
preview_3 = CustomPreview(Geometry=sph_2, Material=ColourSwatch(SwatchColor=RGB(255, 153, 0)))
# Material Estimate
tag_2 = TextTag3D(
    Location=pt_2,
    Text="Center of Gravity Pen holder",
    Size=Slider(3, range=0..100),
    Colour=ColourSwatch(SwatchColor=RGB(133, 80, 0)),
    Justification=7)

material_2 = CreateMaterial(
    Diffuse=ColourSwatch(SwatchColor=RGB(140, 215, 255)),
    Specular=RGB(255, 255, 255),
    Emission=RGB(0, 0, 0),
    Transparency=Slider(1, range=0..1),
    Shine=Slider(100, range=0..100))
volume_2 = Volume(Geometry=bottom)  # -> Volume, Centroid
preview_4 = CustomPreview(Geometry=bottom, Material=material_2)
panel_7 = Panel(volume_2.Centroid)
pt_3 = Point(volume_2.Centroid)
sph_3 = Sphere(Base=pt_3, Radius=Slider(10, range=0..100))
preview_5 = CustomPreview(Geometry=pt_3, Material=ColourSwatch(SwatchColor=RGB(255, 153, 0)))
preview_6 = CustomPreview(Geometry=sph_3, Material=ColourSwatch(SwatchColor=RGB(255, 153, 0)))
tag_3 = TextTag3D(
    Location=pt_3,
    Text="Center of Gravity bottom part",
    Size=Slider(3, range=0..100),
    Colour=ColourSwatch(SwatchColor=RGB(0, 133, 9)),
    Justification=7)

material_3 = CreateMaterial(
    Diffuse=ColourSwatch(SwatchColor=RGB(175, 255, 140)),
    Specular=RGB(255, 255, 255),
    Emission=RGB(0, 0, 0),
    Transparency=Slider(0.9, range=0..1),
    Shine=Slider(100, range=0..100))
volume_3 = Volume(Geometry=brep_2)  # -> Volume, Centroid
preview_7 = CustomPreview(Geometry=brep_2, Material=material_3)
panel_8 = Panel(volume_3.Centroid)
pt_4 = Point(volume_3.Centroid)
swatch_2 = ColourSwatch(SwatchColor=RGB(255, 153, 0))
sph_4 = Sphere(Base=pt_4, Radius=Slider(15, range=0..100))
preview_8 = CustomPreview(Geometry=pt_4, Material=swatch_2)
preview_9 = CustomPreview(Geometry=sph_4, Material=swatch_2)
tag_4 = TextTag3D(
    Location=pt_4,
    Text="Center of Gravity Pen",
    Size=Slider(6, range=0..100),
    Colour=ColourSwatch(SwatchColor=RGB(133, 80, 0)),
    Justification=7)

# ---- group: CREATE AND REMOVE DUPLICATE LINES
item_2 = ListItem(List=clean, Index=0, Wrap=True)  # -> Item, Item1
ln = Line(StartPoint=item_2.Item, EndPoint=item_2.Item1)  # -> flatten(Line)
dupln_2 = RemoveDuplicateLines(Lines=ln, Tolerance=0.01)

# ----
panel_9 = Panel(ln)

# ---- group: FINAL MESH OUTPUT
mp = MultiPipe(
    Curves=dupln_2,
    NodeSize=Slider(0.63, range=0.05..1),
    EndOffset=1,
    StrutSize=Slider(0.69, range=0.05..1),
    Segment=0,
    KinkAngle=0.6,
    CubeFit=0,
    Caps=1)
wbjoin = WeaverbirdsJoinMeshesAndWeld(Mesh=mp, Weld=True)
wbcatmullclark = WeaverbirdsCatmullClarkSubdivision(MeshCurves=wbjoin, Level=Slider(2, range=1..4), SmoothNakedEdges=1)
meshreport = MeshReport(Mesh=wbcatmullclark)
panel_10 = Panel(meshreport)

# ----
# notes: Let us test the volume of the holder is within our desired printing tolerance.
min_volume = Slider(100000, range=0..200000)
stand_max_volume = Slider(200, range=0..200, expression="x*1000")
brep_cell_phone_stand_design = Brep(brep)
color_by_volume = ColorByVolume(num_min_volume=min_volume, num_max_volume=stand_max_volume, brep=brep_cell_phone_stand_design)  # -> num_volume_limit_3, brep_3, bool_meetsvolumelimit_2, brep_volume_2, col_by_volume_2
color_center_of_gravity_fail = ColourSwatch(SwatchColor=RGB(255, 0, 0))
brep_volume = Panel(color_by_volume.brep_volume_2)
bool_meetsvolumelimit = Boolean(color_by_volume.bool_meetsvolumelimit_2)
num_stand_volume = Number(color_by_volume.brep_volume_2)
num_volume_limit = Number(color_by_volume.num_volume_limit_3)
col_by_volume = Colour(color_by_volume.col_by_volume_2)
filter = StreamFilter(Gate=0, Stream0=color_center_of_gravity_fail, Stream1=col_by_volume)

# ----
# if densities are equal
panel_11 = Panel(volume_3.Volume)
panel_12 = Panel(volume.Volume)

# ----
# the contribution to the overall center gravity is proportional to their volume
# Center of Gravity Sum
addition_2 = Addition(A=panel_11, B=panel_12)
panel_13 = Panel(addition_2)
division_3 = Division(A=panel_12, B=addition_2)
# Calculating Center of Gravity of Sum
division_4 = Division(A=panel_11, B=addition_2)
panel_14 = Panel(division_3)
panel_15 = Panel(division_4)
multiplication_3 = Multiplication(A=pt_2, B=division_3)
multiplication_4 = Multiplication(A=pt_4, B=division_4)
addition_3 = Addition(A=multiplication_4, B=multiplication_3)

pt_5 = Point(addition_3)

pt_6 = Point(pt_5)
swatch_3 = ColourSwatch(SwatchColor=RGB(255, 0, 179))
sph_5 = Sphere(Base=pt_6, Radius=Slider(15, range=0..100))
preview_10 = CustomPreview(Geometry=pt_6, Material=swatch_3)
preview_11 = CustomPreview(Geometry=sph_5, Material=swatch_3)
tag_5 = TextTag3D(
    Location=pt_6,
    Text="Center of Gravity Sum",
    Size=Slider(5, range=0..100),
    Colour=ColourSwatch(SwatchColor=RGB(133, 0, 106)),
    Justification=7)

center_of_gravity_of_bottom = Point(addition_3)
col_by_volume_and_stability = Colour(filter)
num_volume_limit_2 = Number(num_volume_limit)
bool_meetsvolumelimit_2 = Boolean(bool_meetsvolumelimit)
num_stand_volume_2 = Number(num_stand_volume)
center_of_gravity_of_sum = Point(addition_3)
cluster_visualize_analysis = ClusterVisualizeAnalysis(
    center_of_gravity_of_bottom=center_of_gravity_of_sum,
    center_of_gravity_of_sum=center_of_gravity_of_bottom,
    col_by_volume_and_stability=col_by_volume_and_stability,
    bool_meetsvolumelimit=bool_meetsvolumelimit_2,
    num_volume_limit=num_volume_limit_2,
    num_stand_volume=num_stand_volume_2)
bool_design_isstable = Boolean(cluster_visualize_analysis)

# ==== cluster ColorByVolume
num_min_volume = ClusterInput()
num_max_volume = ClusterInput()
brep = ClusterInput()
num_min_volume_2 = Number(num_min_volume)
num_max_volume_2 = Number(num_max_volume)
brep_2 = Brep(brep)
volume = Volume(Geometry=brep_2)  # -> Volume, Centroid
brep_volume = Number(volume.Volume)
num_volume_limit = Number(num_max_volume_2)
larger = LargerThan(FirstNumber=brep_volume, SecondNumber=num_max_volume_2)  # -> LargerThan, OrEqualTo
gradient = Gradient(
    LowerLimit=num_min_volume_2,
    UpperLimit=num_max_volume_2,
    Parameter=brep_volume,
    stops=[0: RGB(0, 128, 0), 0.5: RGB(255, 255, 0), 1: RGB(204, 0, 0)])
not = GateNot(A=larger.OrEqualTo)
bool_meetsvolumelimit = Boolean(not)
num_volume_limit_2 = Number(num_volume_limit)
col_by_volume = Colour(gradient)
num_volume_limit_3 = ClusterOutput(num_volume_limit_2)
brep_3 = ClusterOutput(brep_2)
bool_meetsvolumelimit_2 = ClusterOutput(bool_meetsvolumelimit)
brep_volume_2 = ClusterOutput(brep_volume)
col_by_volume_2 = ClusterOutput(col_by_volume)

# ==== cluster ClusterVisualizeAnalysis
center_of_gravity_of_bottom = ClusterInput()
center_of_gravity_of_sum = ClusterInput()
col_by_volume_and_stability = ClusterInput()
bool_meetsvolumelimit = ClusterInput()
num_stand_volume = ClusterInput()
num_volume_limit = ClusterInput()
num_stand_volume_2 = Number(num_stand_volume)
Z = UnitZ(Factor=center_of_gravity_of_bottom)
Z_2 = UnitZ(Factor=center_of_gravity_of_sum)
smaller = SmallerThan(FirstNumber=Z, SecondNumber=Z_2)  # -> SmallerThan, OrEqualTo
panel = Panel(smaller.OrEqualTo)
col_by_volume_and_stability_2 = Colour(col_by_volume_and_stability)
bool_meetsvolumelimit_2 = Boolean(bool_meetsvolumelimit)
num_stand_volume_3 = Number(num_stand_volume_2)
num_volume_limit_2 = Number(num_volume_limit)
# notes: Here we have a custom preview which will 'render' the object with a color that corresponds to target print volumes, and shares messages about the design.
cluster_display = ClusterDisplay(
    col_stable=col_by_volume_and_stability_2,
    bool_phone_stable=panel,
    bool_meetsvolumelimit=bool_meetsvolumelimit_2,
    num_stand_volume=num_stand_volume_3,
    num_volume_limit=num_volume_limit_2)
bool_design_isstable = ClusterOutput(cluster_display)

# ==== cluster ClusterDisplay
num_stand_volume = ClusterInput()
num_volume_limit = ClusterInput()
bool_meetsvolumelimit = ClusterInput()
brep_cell_phone_stand_design = ClusterInput()
srf_common_surface_phone = ClusterInput()
srf_common_surface_base = ClusterInput()
bool_phone_stable = ClusterInput()
bool_basestable = ClusterInput()
bool_breps_intersect = ClusterInput()
pln_design_origin = ClusterInput()
col_stable = ClusterInput()
col_stable_2 = Colour(col_stable)
bool_phone_stable_2 = Boolean(bool_phone_stable)
brep_cell_phone_stand_design_2 = Brep(brep_cell_phone_stand_design)
srf_common_surface_phone_2 = Surface(srf_common_surface_phone)
srf_common_surface_base_2 = Surface(srf_common_surface_base)
bool_basestable_2 = Boolean(bool_basestable)
bool_meetsvolumelimit_2 = Boolean(bool_meetsvolumelimit)
num_volume_limit_2 = Number(num_volume_limit)
pln_design_origin_2 = Plane(pln_design_origin)
bool_breps_intersect_2 = Boolean(bool_breps_intersect)
num_stand_volume_2 = Number(num_stand_volume)
stable = ColourSwatch(SwatchColor=RGB(133, 186, 255))
null = NullItem(Item=col_stable_2)  # -> NullFlags, InvalidFlags, Description
round = Round(Number=num_stand_volume_2)  # -> Nearest, Floor, Ceiling
eval = Evaluate(F="If(test, color01,color02)", test=null.NullFlags, color01=stable, color02=col_stable_2)
panel = Panel("Phone to Base interface unstable. Check the phone center of gravity relative to stand slot projection.")
cir = Circle(Plane=pln_design_origin_2, Radius="75")
col_stable_3 = Colour(eval)
and = GateAnd(A=bool_basestable_2, B=bool_meetsvolumelimit_2)
panel_2 = Panel("""Assembly is unstable.
The phone does not sit in the base.""")
bool_breps_intersect_3 = Boolean(bool_breps_intersect_2)
eval_2 = EvaluateCurve(Curve=cir, Parameter="0")  # -> Point, Tangent, Angle
and_2 = GateAnd(A=bool_phone_stable_2, B=and)
concat = Concatenate(FragmentA="Stand volume (", FragmentB=round.Nearest)
unstable = ColourSwatch(SwatchColor=RGB(168, 84, 84))
concat_2 = Concatenate(FragmentA=concat, FragmentB="mm³) exceeds limit: ")
concat_3 = Concatenate(FragmentA=concat_2, FragmentB=num_volume_limit_2)
bool_breps_intersect_4 = Boolean(bool_breps_intersect_2)
unstable_2 = ColourSwatch(SwatchColor=RGB(255, 0, 0))
material = CreateMaterial(Diffuse=unstable, Specular=RGB(255, 255, 255), Emission=RGB(0, 0, 0), Transparency=Slider(1, range=0..1), Shine=0)
and_3 = GateAnd(A=bool_phone_stable_2, B=bool_basestable_2)
concat_4 = Concatenate(FragmentA=concat_3, FragmentB="mm³")
unstable_3 = ColourSwatch(SwatchColor=RGB(255, 0, 0))
unstable_4 = ColourSwatch(SwatchColor=RGB(255, 0, 0))
filter = StreamFilter(Gate=bool_breps_intersect_4, Stream0=unstable_2, Stream1=material)
filter_2 = StreamFilter(Gate=bool_meetsvolumelimit_2, Stream0=concat_4)
filter_3 = StreamFilter(Gate=bool_basestable_2, Stream0="Base to Sitting Surface interface unstable.")
filter_4 = StreamFilter(Gate=bool_phone_stable_2, Stream0=panel)
col_stable_4 = Colour(col_stable_3)
filter_5 = StreamFilter(Gate=and_2, Stream0="Assembly is not good. ", Stream1="Assembly is good.")
filter_6 = StreamFilter(Gate=bool_phone_stable_2, Stream0=unstable_3)
filter_7 = StreamFilter(Gate=and_3, Stream0=filter, Stream1=col_stable_4)
filter_8 = StreamFilter(Gate=bool_basestable_2, Stream0=unstable_4)
concat_5 = Concatenate(FragmentA=filter_5, FragmentB=filter_4)
concat_6 = Concatenate(FragmentA=concat_5, FragmentB=filter_3)
concat_7 = Concatenate(FragmentA=concat_6, FragmentB=filter_2)
filter_9 = StreamFilter(Gate=bool_breps_intersect_3, Stream0=panel_2, Stream1=concat_7)
and_4 = GateAnd(A=bool_breps_intersect_3, B=and_2)
preview = CustomPreview(Geometry=brep_cell_phone_stand_design_2, Material=filter_7)
preview_2 = CustomPreview(Geometry=srf_common_surface_phone_2, Material=filter_6)
preview_3 = CustomPreview(Geometry=srf_common_surface_base_2, Material=filter_8)
txt_result = Text(filter_9)
bool_design_isstable = Boolean(and_4)
pt_label = Point(eval_2.Point)
bool_design_isstable_2 = ClusterOutput(bool_design_isstable)
filter_10 = StreamFilter(Gate=and_2, Stream0=ColourSwatch(SwatchColor=RGB(255, 0, 0)), Stream1=ColourSwatch(SwatchColor=RGB(0, 0, 0)))
tag = TextTag3D(Location=pt_label, Text=txt_result, Size="8", Colour=filter_10, Justification=4)
