# Grasshopper definition RockingPenHolder.gh (Grasshopper 1.0.8)

vec = VectorXYZ(XComponent=0, YComponent=0, ZComponent=0)  # -> Vector, Length
origin = Point(vec.Vector)
number_slider = Slider(0.578, range=0..1)
number_slider_2 = Slider(1144, range=0..1800)
num = Number(number_slider_2)
division = Division(A=num, B="0.2")
multiplication = Multiplication(A=number_slider_2, B=number_slider)
Z = UnitZ(Factor=multiplication)
move = Move(Geometry=origin, Motion=Z)  # -> Geometry, Transform
neg = Negative(Value=division)
pln = Plane(move.Geometry)
dom = ConstructDomain(DomainStart=division, DomainEnd=neg)
domain = Domain(dom)
sph = Sphere(Base=pln, Radius=number_slider_2)
rectangle = Rectangle(Plane=pln, XSize=domain, YSize=domain, Radius=0)  # -> Rectangle, Length
multiplication_2 = Multiplication(A=multiplication, B=Slider(2, range=0..10))
scale_nu = ScaleNU(Geometry=sph, Plane=pln, ScaleX=1, ScaleY=1, ScaleZ=number_slider)  # -> Geometry, Transform
boxrec = BoxRectangle(Rectangle=rectangle.Rectangle, Height=multiplication_2)
number_slider_3 = Slider(30, range=30..100)
number_slider_4 = Slider(1834, range=0..4000)
neg_2 = Negative(Value=number_slider_3)
Z_2 = UnitZ(Factor=number_slider_4)
cir = Circle(Plane=pln, Radius=number_slider_2)
offset = OffsetCurve(Curve=cir, Distance=neg_2, Plane=pln, Corners=1)
move_2 = Move(Geometry=pln, Motion=Z_2)  # -> Geometry, Transform
panel = Panel(number_slider_2)
pln_2 = Plane(move_2.Geometry)
dom_2 = ConstructDomain(DomainStart="0", DomainEnd="1")
dom_3 = ConstructDomain(DomainStart=number_slider_3, DomainEnd=panel)
cir_2 = Circle(Plane=move_2.Geometry, Radius=number_slider_2)
remap = RemapNumbers(Value=Slider(0.429, range=0..0.9), Source=dom_2, Target=dom_3)  # -> Mapped, Clipped
neg_3 = Negative(Value=remap.Mapped)
neg_4 = Negative(Value=number_slider_3)
panel_2 = Panel(remap.Mapped)
offset_2 = OffsetCurve(Curve=cir_2, Distance=neg_3, Plane=pln_2, Corners=1)
offset_3 = OffsetCurve(Curve=offset_2, Distance=neg_4, Corners=1)
Z_3 = UnitZ(Factor=number_slider_4)
neg_5 = Negative(Value=Z_3)
inner_circle = Merge(Data1=offset_3, Data2=offset)
outter_cricle = Merge(Data1=offset_2, Data2=cir)
darc = DeconstructArc(Arc=offset_3)  # -> BasePlane, Radius, Angle
addition = Addition(A=number_slider_4, B=Slider(913, range=0..1000))
move_3 = Move(Geometry=offset_3, Motion=neg_5)  # -> Geometry, Transform
loft_outter = Loft(
    Curves=flatten(outter_cricle),
    Options={Adjust=False, Closed=False, LoftEnds=0, LoftSimp=0, LoftType=0, Rebuild=10, Refit=0.01})
loft_inner = Loft(
    Curves=flatten(inner_circle),
    Options={Adjust=False, Closed=False, LoftEnds=0, LoftSimp=0, LoftType=0, Rebuild=10, Refit=0.01})
cyl = Cylinder(Base=move_3.Geometry, Radius=darc.Radius, Length=addition)
cap = CapHoles(Brep=loft_outter)
cap_2 = CapHoles(Brep=loft_inner)
cap_3 = CapHoles(Brep=cyl)
sdiff = SolidDifference(BrepsA=scale_nu.Geometry, BrepsB=boxrec)
sdiff_2 = SolidDifference(BrepsA=cap, BrepsB=cap_2)
volume = Volume(Geometry=cap_3)  # -> Volume, Centroid
top = Brep(sdiff_2)
bottom = Brep(sdiff)
panel_3 = Panel(volume.Centroid)
merge = Merge(Data1=top, Data2=bottom)
sunion = SolidUnion(Breps=merge)
brep = Brep(sunion)
volume_2 = Volume(Geometry=brep)  # -> Volume, Centroid
panel_4 = Panel(volume_2.Centroid)
